# Grasshopper definition COS200 Final.gh (Grasshopper 1.0.7)

# ---- group: Weave Generator
detail = Slider(20, range=2..50)
T = Slider(6, range=0..10)
R = Slider(6, range=0..10)
surface = Surface(<surface referenced from the Rhino model>)
weave_generator = GhPythonScript(Surface=surface, Detail=detail, Thickness=T, Rope_Size=R)  # -> console, Output; inputs Surface: Brep, Detail: Int32
# ---------- weave_generator: Python ----------
# Weave Generator

import rhinoscriptsyntax as rs
import ghpythonlib.components as ghp
import random as r

# Creating Point Array
DS = ghp.DivideSurface(Surface,Detail,Detail)
points = DS[0]
normals = DS[1]

# Point set 1 - White
movedPts1 = []
for i in range(len(points)):
    if i % 2 == 0:
        movedPts1.append((ghp.Move(points[i],((normals[i])*Thickness)))[0])
    
    if i % 2 == 1:
        movedPts1.append((ghp.Move(points[i],(-1*(normals[i])*Thickness)))[0])

# Point set 2 - Black
movedPts2 = []
for i in range(len(points)):
    if i % 2 == 1:
        movedPts2.append((ghp.Move(points[i],((normals[i])*Thickness)))[0])
    
    if i % 2 == 0:
        movedPts2.append((ghp.Move(points[i],(-1*(normals[i])*Thickness)))[0])

# Spline set 1
a = 0
splineOut1 = []
for e in range(Detail+1):
    temp_list = []
    
    for i in range(Detail+1):
        temp_list.append(movedPts1[i+(Detail*a)+e])
    
    a += 1
    splineOut1.append((ghp.Interpolate(temp_list,3,False,0))[0])

# Spline set 2
a = 0
splineOut2 = []
for e in range(Detail+1):
    temp_list = []
    
    for i in range(Detail+1):
        temp_list.append(movedPts2[(i*(Detail+1))+e])
    
    a += 1
    splineOut2.append((ghp.Interpolate(temp_list,3,False,0))[0])

# Pipes
splines = ghp.Merge(splineOut1,splineOut2)
Output = ghp.Pipe(splines,Rope_Size,True)
# ---------- end weave_generator ----------
panel = Panel(weave_generator.console)
shader = Shader({diffuse=RGB(255, 255, 255), emission=RGB(0, 0, 0), shine=0, specular=RGB(255, 255, 255), transparency=0})
custom_preview = CustomPreview(Geometry=weave_generator.Output, Material=shader)

# ----
colour_picker = ColourPicker(PickedColour=RGB(148, 57, 70))
colour_picker_2 = ColourPicker(PickedColour=RGB(148, 57, 70))

# ---- group: Stamped Metal Plate
detail_2 = Slider(19, range=2..50)
detail_3 = Slider(26, range=2..50)
max_height = Slider(6, range=2..100)
curve = Curve(<curve referenced from the Rhino model>)
ghpython_script = GhPythonScript(Area=curve, S1_Detail=detail_2, S2_Detail=detail_3, Max_Height=max_height, Re_run=Button())  # -> console, points, output; inputs Area: Curve, Max_Height: Int32, Re_run: Int32
# ---------- ghpython_script: Python ----------
# Parametric Metal Plate Thing

import rhinoscriptsyntax as rs
import ghpythonlib.components as ghp
import random as r

# Create Empty Point List
points = []

SL = ghp.SegmentLengths(Area)

side_len1 = round(float(SL[2]))
side_len2 = round(float(SL[0]))
#print(side_len1, side_len2)

#side_len1/S1_Detail

# Creating Point Array
for e in range(int(S2_Detail)+1):
    for i in range(int(S1_Detail)+1):
        points.append(rs.CreatePoint((side_len1/S1_Detail*i),side_len2/S2_Detail*e,0))

# Setting Base Thickness
rs.MoveObjects(points, ghp.UnitZ(10))

# Randomizing Heights
for point in points:
    rs.MoveObject(point, ghp.UnitZ(r.randint(2,Max_Height)))

# Determine U-Count
if S1_Detail > S2_Detail:
    a = S1_Detail
else:
    a = S2_Detail

UC = a + 1

# Create Top Surface
top_srf = ghp.SurfaceFromPoints(points, UC, True)

# Makeing Surface Object Solid
output = ghp.Extrude(top_srf, ghp.Negative(ghp.UnitZ(2)))
# ---------- end ghpython_script ----------
shader_2 = Shader({diffuse=RGB(0, 0, 0), emission=RGB(0, 0, 0), shine=0.7004216909, specular=RGB(141, 96, 77), transparency=0})
panel_2 = Panel(ghpython_script.points)
panel_3 = Panel(ghpython_script.console)
custom_preview_2 = CustomPreview(Geometry=ghpython_script.output, Material=colour_picker_2)
cloud_display = CloudDisplay(Points=panel_2, Colours=RGB(255, 20, 147), Size=Slider(3, range=0..10), SpriteType=0)

# ----
interpolate = Interpolate(Degree=3, Periodic=False, KnotStyle=1)  # -> Curve, Length, Domain
pt_size = Slider(4, range=0..10)
colour = ColourSwatch(SwatchColor=RGB(255, 255, 255))
cloud_display_2 = CloudDisplay(Colours=colour, Size=pt_size, SpriteType=0)
point_list = PointList(Size=Slider(7, range=0..10))
pt_size_2 = Slider(4, range=0..10)
colour_2 = ColourSwatch(SwatchColor=RGB(0, 0, 0))
cloud_display_3 = CloudDisplay(Colours=colour_2, Size=pt_size_2, SpriteType=0)
