# Grasshopper definition COS200_Final_Metal_Plate.gh (Grasshopper 1.0.7)

# ---- group: Stamped Metal Plate
detail = Slider(20, range=2..50)
detail_2 = Slider(20, range=2..50)
max_height = Slider(10, range=2..100)
curve = Curve(<curve referenced from the Rhino model>)
ghpython_script = GhPythonScript(Area=curve, S1_Detail=detail, S2_Detail=detail_2, Max_Height=max_height, Re_run=Button())  # -> console, points, output; inputs Area: Curve, Max_Height: Int32, Re_run: Int32
# ---------- ghpython_script: Python ----------
# Parametric Metal Plate Thing

import rhinoscriptsyntax as rs
import ghpythonlib.components as ghp
import random as r

# Create Empty Point List
points = []

SL = ghp.SegmentLengths(Area)

side_len1 = round(float(SL[2]))
side_len2 = round(float(SL[0]))
#print(side_len1, side_len2)

#side_len1/S1_Detail

# Creating Point Array
for e in range(int(S2_Detail)+1):
    for i in range(int(S1_Detail)+1):
        points.append(rs.CreatePoint((side_len1/S1_Detail*i),side_len2/S2_Detail*e,0))

# Setting Base Thickness
rs.MoveObjects(points, ghp.UnitZ(10))

# Randomizing Heights
for point in points:
    rs.MoveObject(point, ghp.UnitZ(r.randint(2,Max_Height)))

# Determine U-Count
if S1_Detail > S2_Detail:
    a = S1_Detail
else:
    a = S2_Detail

UC = a + 1

# Create Top Surface
top_srf = ghp.SurfaceFromPoints(points, UC, True)

# Makeing Surface Object Solid
output = ghp.Extrude(top_srf, ghp.Negative(ghp.UnitZ(2)))
# ---------- end ghpython_script ----------
shader = Shader({diffuse=RGB(0, 0, 0), emission=RGB(0, 0, 0), shine=0.7004216909, specular=RGB(141, 96, 77), transparency=0})
panel = Panel(ghpython_script.points)
panel_2 = Panel(ghpython_script.console)
custom_preview = CustomPreview(Geometry=ghpython_script.output, Material=shader)
cloud_display = CloudDisplay(Points=panel, Colours=RGB(255, 20, 147), Size=Slider(3, range=0..10), SpriteType=0)

# ----
colour_picker = ColourPicker(PickedColour=RGB(148, 57, 70))
