# Grasshopper definition COS200_Final_Weave_Generator.gh (Grasshopper 1.0.7)

# ---- group: Weave Generator
detail = Slider(17, range=2..50)
radius = Slider(3, range=0..10)
T = Slider(4, range=0..10)
surface = Surface(<surface referenced from the Rhino model>)
weave_generator = GhPythonScript(Surface=surface, Detail=detail, Thickness=T, Rope_Size=radius)  # -> console, points, Output; inputs Surface: Brep
# ---------- weave_generator: Python ----------
# Weave Generator

import rhinoscriptsyntax as rs
import ghpythonlib.components as ghp
import random as r

# Creating Point Array
DS = ghp.DivideSurface(Surface,Detail,Detail)
points = DS[0]
normals = DS[1]

# Point set 1 - Black
movedPts1 = []
for i in range(len(points)):
    if i % 2 == 0:
        movedPts1.append((ghp.Move(points[i],((normals[i])*Thickness)))[0])
    
    if i % 2 == 1:
        movedPts1.append((ghp.Move(points[i],(-1*(normals[i])*Thickness)))[0])

# Point set 2 - White
movedPts2 = []
for i in range(len(points)):
    if i % 2 == 1:
        movedPts2.append((ghp.Move(points[i],((normals[i])*Thickness)))[0])
    
    if i % 2 == 0:
        movedPts2.append((ghp.Move(points[i],(-1*(normals[i])*Thickness)))[0])

# Spline set 1
a = 0
splineOut1 = []
for e in range(Detail+1):
    temp_list = []
    
    for i in range(Detail+1):
        temp_list.append(movedPts1[i+(Detail*a)+e])
    
    a += 1
    splineOut1.append((ghp.Interpolate(temp_list,3,False,0))[0])

# Spline set 2
a = 0
splineOut2 = []
for e in range(Detail+1):
    temp_list = []
    
    for i in range(Detail+1):
        temp_list.append(movedPts2[(i*(Detail+1))+e])
    
    a += 1
    splineOut2.append((ghp.Interpolate(temp_list,3,False,0))[0])

# Pipes
splines = ghp.Merge(splineOut1,splineOut2)
Output = ghp.Pipe(splines,Rope_Size,True)
# ---------- end weave_generator ----------
panel = Panel(weave_generator.console)
shader = Shader({diffuse=RGB(255, 255, 255), emission=RGB(0, 0, 0), shine=0, specular=RGB(255, 255, 255), transparency=0})
custom_preview = CustomPreview(Geometry=weave_generator.Output, Material=shader)

# ----
sdivide = DivideSurface(UCount=10, VCount=10)  # -> Points, Normals, Parameters
pt_size = Slider(4, range=0..10)
colour = ColourSwatch(SwatchColor=RGB(255, 255, 255))
cloud_display = CloudDisplay(Colours=colour, Size=pt_size, SpriteType=0)
point_list = PointList(Points=sdivide.Points, Size=Slider(7, range=0..10))
pt_size_2 = Slider(4, range=0..10)
colour_2 = ColourSwatch(SwatchColor=RGB(0, 0, 0))
cloud_display_2 = CloudDisplay(Colours=colour_2, Size=pt_size_2, SpriteType=0)
